# Grasshopper definition test.gh (Grasshopper 1.0.7)
# plug-ins: NC_NCascade

# ---- group: Vase lion paper fig.
lion_3cas_pts = Point([Point(-2.60148, 0.330192, -0.371979), Point(-2.71463, 0.266662, -0.152416), Point(-2.54105, 0.2085, -0.0920212), Point(-2.57063, 0.134513, 0.043705), Point(-2.76792, 0.111898, 0.229119), Point(-2.63377, 0.024141, 0.39407)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])
lion_mesh = Mesh(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)
lion2cas_1_pts = Point([Point(-2.66894, -0.956497, 2.04998), Point(-2.83122, -1.09534, 1.62792), Point(-2.82098, -1.08324, 1.32455), Point(-2.81954, -1.15402, 1.06388), Point(-2.66971, -1.30338, 0.854409), Point(-2.68015, -1.21564, 1.93664), Point(-2.71152, -1.35263, 1.55325), Point(-2.718278593, -1.374544369, 1.387529113), Point(-2.72575, -1.39877, 1.20433), Point(-2.49666, -1.40987, 1.05142), Point(-2.49181, -1.56673, 1.87239), Point(-2.50102, -1.54568, 1.57964), Point(-2.51925, -1.5386, 1.26048), Point(-2.37263, -1.59598, 1.11024), Point(-2.23644, -1.70886, 1.8573), Point(-2.27933, -1.63493, 1.44913), Point(-2.1813, -1.67072, 1.11625), Point(-1.9686, -1.77935, 1.81672), Point(-1.96128, -1.77958, 1.50131), Point(-2.02773, -1.64244, 1.30087)])
lion_2cas_2_pts = Point([Point(-2.560174845, -0.5376835017, -0.6359290838), Point(-2.5052, -0.609509, -0.763331), Point(-2.359155437, -0.6652916274, -0.8389171325), Point(-2.22067, -0.718187, -0.910591), Point(-1.91097, -0.858561, -0.88131), Point(-2.56197438, -0.7747444775, -0.5465384406)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])

# ---- group: Bimba paper fig.
bimba_3cas_pts = Point([Point(-1.26357, 1.45197, -0.387635), Point(-1.45952, 1.29384, -0.362456), Point(-1.61655, 1.12842, -0.357625), Point(-1.72371, 0.957417, -0.371553), Point(-1.81754, 0.76055, -0.410065), Point(-1.8886, 0.527618, -0.456711)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])
bimbaneck_mesh = Mesh(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)
bimba_2cas_pts = Point([Point(-0.629777, 1.99616, -0.950649), Point(-0.894895, 1.98947, -0.884246), Point(-1.16724, 1.9671, -0.813576), Point(-1.37523, 1.89882, -0.736053), Point(-1.58953, 1.76948, -0.661103), Point(-0.608215, 1.8288, -0.736867)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])

# ---- group: Bunny paper fig.
bunny_head_3cas_pts = Point([Point(2.94994446, -1.57853, -0.00666591), Point(2.93886346, -1.60072, -0.00327801), Point(2.91539146, -1.61578, 0.0185298), Point(2.89296946, -1.63814, 0.02647), Point(2.88164746, -1.66649, 0.0122011), Point(2.87068846, -1.69754, -0.0137423)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])
bunnyhead_mesh = Mesh(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)

# ----
casnetgenerator = CasNetGenerator(N_size=Slider(3, range=1..10), Case=Slider(0, range=0..27), Sph_r_inc=Slider(0, range=-15..15))  # -> Dij, Dij_edge, Sphere, ExtSurf, Bv_file
geo = Geometry(casnetgenerator.Dij_edge)
geo_2 = Geometry(casnetgenerator.ExtSurf)
pt = Point(casnetgenerator.Dij)
# Net input order for NC4_Ncascade;
# i.e. 3Cascade-net (n=4)
# 
# 
# 24--25--26
# |        |
# 21--22--23
# |          |
# 17--18--19--20
# |              |
# 12--13--14--15--16
# |                |
# 6--7--8--9--10--11
# |                |
# 0--1--2--3---4---5
nc4_ncascade = NC4_NCascade(Pts=casnetgenerator.Dij)  # -> Dij, Dij_Lines, TensorLines, RptensorLines, RepTBpts, Nc_Pts, Nc_Edges, Nc_Surfs, Bvfile
click_to_save = Button()
path = FilePath("C:\Users\azrai\Downloads\")
geo_3 = Geometry(nc4_ncascade.Nc_Surfs)
save_bv_file = CSharpScript(bvfile_cap=nc4_ncascade.Bvfile, bvfile_ext=casnetgenerator.Bv_file, save_location=path, boolean=click_to_save)  # inputs bvfile_cap: String, save_location: String, boolean: Boolean
# ---------- save_bv_file: C# usings ----------
using System.IO;
using System.Text;
# ---------- save_bv_file: C# ----------
    StringBuilder bvfile = new StringBuilder();
    bvfile.Append(bvfile_ext);
    bvfile.Append(bvfile_cap);


    if(boolean)
    {
      string path = save_location + "surface.bv";

      if (File.Exists(path))
      {
        File.Delete(path);
      }


      File.WriteAllText(path, bvfile.ToString());
    }
# ---------- end save_bv_file ----------
bv_file = Text(flatten([casnetgenerator.Bv_file, nc4_ncascade.Bvfile]))
copy_this_text_right_click_copy_data_onl = Panel(bv_file)  # "Copy this text (right click -> Copy Data Only) to an empty file to obtain .bv format."
